test file "TEST"

suite "New Test Suite 1"

  case "New Test Case 1" [baseline]
    test data file: TESTSHEET.xls
    model TCS0731, harness TCS0731_Harness2
    parameter set "TESTSHEET.xls":
      BiasAdd = 0  % mask workspace, TCS0731/Subsystem/Saturation Dynamic/Data Type Propagation
      BiasAdd = 0  % mask workspace, TCS0731/Subsystem/Saturation Dynamic1/Data Type Propagation
      BiasAdd = 0  % mask workspace, TCS0731/Subsystem/Saturation Dynamic2/Data Type Propagation
      BiasBase = Bias1  % mask workspace, TCS0731/Subsystem/Saturation Dynamic/Data Type Propagation
      BiasBase = Bias1  % mask workspace, TCS0731/Subsystem/Saturation Dynamic1/Data Type Propagation
      BiasBase = Bias1  % mask workspace, TCS0731/Subsystem/Saturation Dynamic2/Data Type Propagation
      BiasMult = 1  % mask workspace, TCS0731/Subsystem/Saturation Dynamic/Data Type Propagation
      BiasMult = 1  % mask workspace, TCS0731/Subsystem/Saturation Dynamic1/Data Type Propagation
      BiasMult = 1  % mask workspace, TCS0731/Subsystem/Saturation Dynamic2/Data Type Propagation
      DisallowWideOutput = off  % mask workspace, TCS0731/Function-Call Generator
      IfRefDouble = double  % mask workspace, TCS0731/Subsystem/Saturation Dynamic/Data Type Propagation
      IfRefDouble = double  % mask workspace, TCS0731/Subsystem/Saturation Dynamic1/Data Type Propagation
      IfRefDouble = double  % mask workspace, TCS0731/Subsystem/Saturation Dynamic2/Data Type Propagation
      IfRefSingle = single  % mask workspace, TCS0731/Subsystem/Saturation Dynamic/Data Type Propagation
      IfRefSingle = single  % mask workspace, TCS0731/Subsystem/Saturation Dynamic1/Data Type Propagation
      IfRefSingle = single  % mask workspace, TCS0731/Subsystem/Saturation Dynamic2/Data Type Propagation
      IsSigned = IsSigned1  % mask workspace, TCS0731/Subsystem/Saturation Dynamic/Data Type Propagation
      IsSigned = IsSigned1  % mask workspace, TCS0731/Subsystem/Saturation Dynamic1/Data Type Propagation
      IsSigned = IsSigned1  % mask workspace, TCS0731/Subsystem/Saturation Dynamic2/Data Type Propagation
      NumBitsAdd = 0  % mask workspace, TCS0731/Subsystem/Saturation Dynamic/Data Type Propagation
      NumBitsAdd = 0  % mask workspace, TCS0731/Subsystem/Saturation Dynamic1/Data Type Propagation
      NumBitsAdd = 0  % mask workspace, TCS0731/Subsystem/Saturation Dynamic2/Data Type Propagation
      NumBitsAllowFinal = 1:128  % mask workspace, TCS0731/Subsystem/Saturation Dynamic/Data Type Propagation
      NumBitsAllowFinal = 1:128  % mask workspace, TCS0731/Subsystem/Saturation Dynamic1/Data Type Propagation
      NumBitsAllowFinal = 1:128  % mask workspace, TCS0731/Subsystem/Saturation Dynamic2/Data Type Propagation
      NumBitsBase = NumBits1  % mask workspace, TCS0731/Subsystem/Saturation Dynamic/Data Type Propagation
      NumBitsBase = NumBits1  % mask workspace, TCS0731/Subsystem/Saturation Dynamic1/Data Type Propagation
      NumBitsBase = NumBits1  % mask workspace, TCS0731/Subsystem/Saturation Dynamic2/Data Type Propagation
      NumBitsMult = 1  % mask workspace, TCS0731/Subsystem/Saturation Dynamic/Data Type Propagation
      NumBitsMult = 1  % mask workspace, TCS0731/Subsystem/Saturation Dynamic1/Data Type Propagation
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    input "Scenario1" from TESTSHEET.xls, mapped to WhlSpd_kph, TrqRequst_Act_Nm, VehSpd_kph (active)
    baseline "Scenario1"
      TCS_TrqReqst_Raw
      TCS_ExitFinal
      Trq_I_Start
      Trq_I_FF
      Verror_mps
      TCS_flgActv
      TCS_TrqRequestFinal_Nm