test file "IntegralJudgementTEST"

suite "New Test Suite 1"

  case "New Test Case 1" [baseline]
    test data file: IntegralJudgementTesrSHEET.xls
    model untitled, harness untitled_Harness2
    parameter set "IntegralJudgementTesrSHEET.xls":
      TrqRquRate = 0.1  % base workspace
      const = TrqRquRate  % mask workspace, untitled/Subsystem/Compare To Constant
      const = 0  % mask workspace, untitled/Subsystem/Compare To Constant1
    input "Scenario1" from IntegralJudgementTesrSHEET.xls, mapped to WhlSlipFL_flag, WhlSlipFR_flag, WhlSlipRL_flag, WhlSlipRR_flag, IMU_Ax_mpss, FFVehVxEst_mps, TrqReq_Nm, WhlSpdMax_mps (active)
    baseline "Scenario1"
      VxIMU_est
      IMUAccIns_ACT
      IMUVehSpdEstiExit
      Saturation:1
      VehSpdInit_mps
      VxIMU_est
      IMUVehSpdEstiExit