test file "WhlSlipJudgementTEST"

suite "New Test Suite 1"

  case "New Test Case 1" [baseline]
    test data file: WhlSlipJudgementTestSHEET.xls
    model SlipJudgement, harness SlipJudgement_Harness1
    parameter set "WhlSlipJudgementTestSHEET.xls":
      BiasAdd = 0  % mask workspace, SlipJudgement/Subsystem/加速度差判断/Filter/Rate Limiter Dynamic/Saturation Dynamic/Data Type Propagation
      BiasAdd = 0  % mask workspace, SlipJudgement/Subsystem/加速度差判断/Filter/Saturation Dynamic/Data Type Propagation
      BiasAdd = 0  % mask workspace, SlipJudgement/Subsystem/加速度差判断/Filter1/Rate Limiter Dynamic/Saturation Dynamic/Data Type Propagation
      BiasAdd = 0  % mask workspace, SlipJudgement/Subsystem/加速度差判断/Filter1/Saturation Dynamic/Data Type Propagation
      BiasAdd = 0  % mask workspace, SlipJudgement/Subsystem/加速度差判断/Filter2/Rate Limiter Dynamic/Saturation Dynamic/Data Type Propagation
      BiasAdd = 0  % mask workspace, SlipJudgement/Subsystem/加速度差判断/Filter2/Saturation Dynamic/Data Type Propagation
      BiasAdd = 0  % mask workspace, SlipJudgement/Subsystem/加速度差判断/Filter3/Rate Limiter Dynamic/Saturation Dynamic/Data Type Propagation
      BiasAdd = 0  % mask workspace, SlipJudgement/Subsystem/加速度差判断/Filter3/Saturation Dynamic/Data Type Propagation
      BiasAdd = 0  % mask workspace, SlipJudgement/Subsystem/加速度差的微分的判断/Filter/Rate Limiter Dynamic/Saturation Dynamic/Data Type Propagation
      BiasAdd = 0  % mask workspace, SlipJudgement/Subsystem/加速度差的微分的判断/Filter/Saturation Dynamic/Data Type Propagation
      BiasAdd = 0  % mask workspace, SlipJudgement/Subsystem/加速度差的微分的判断/Filter1/Rate Limiter Dynamic/Saturation Dynamic/Data Type Propagation
      BiasAdd = 0  % mask workspace, SlipJudgement/Subsystem/加速度差的微分的判断/Filter1/Saturation Dynamic/Data Type Propagation
      BiasAdd = 0  % mask workspace, SlipJudgement/Subsystem/加速度差的微分的判断/Filter2/Rate Limiter Dynamic/Saturation Dynamic/Data Type Propagation
      BiasAdd = 0  % mask workspace, SlipJudgement/Subsystem/加速度差的微分的判断/Filter2/Saturation Dynamic/Data Type Propagation
      BiasAdd = 0  % mask workspace, SlipJudgement/Subsystem/加速度差的微分的判断/Filter3/Rate Limiter Dynamic/Saturation Dynamic/Data Type Propagation
      BiasAdd = 0  % mask workspace, SlipJudgement/Subsystem/加速度差的微分的判断/Filter3/Saturation Dynamic/Data Type Propagation
      BiasBase = Bias1  % mask workspace, SlipJudgement/Subsystem/加速度差判断/Filter/Rate Limiter Dynamic/Saturation Dynamic/Data Type Propagation
      BiasBase = Bias1  % mask workspace, SlipJudgement/Subsystem/加速度差判断/Filter/Saturation Dynamic/Data Type Propagation
      BiasBase = Bias1  % mask workspace, SlipJudgement/Subsystem/加速度差判断/Filter1/Rate Limiter Dynamic/Saturation Dynamic/Data Type Propagation
      BiasBase = Bias1  % mask workspace, SlipJudgement/Subsystem/加速度差判断/Filter1/Saturation Dynamic/Data Type Propagation
      BiasBase = Bias1  % mask workspace, SlipJudgement/Subsystem/加速度差判断/Filter2/Rate Limiter Dynamic/Saturation Dynamic/Data Type Propagation
      BiasBase = Bias1  % mask workspace, SlipJudgement/Subsystem/加速度差判断/Filter2/Saturation Dynamic/Data Type Propagation
      BiasBase = Bias1  % mask workspace, SlipJudgement/Subsystem/加速度差判断/Filter3/Rate Limiter Dynamic/Saturation Dynamic/Data Type Propagation
      BiasBase = Bias1  % mask workspace, SlipJudgement/Subsystem/加速度差判断/Filter3/Saturation Dynamic/Data Type Propagation
      BiasBase = Bias1  % mask workspace, SlipJudgement/Subsystem/加速度差的微分的判断/Filter/Rate Limiter Dynamic/Saturation Dynamic/Data Type Propagation
      BiasBase = Bias1  % mask workspace, SlipJudgement/Subsystem/加速度差的微分的判断/Filter/Saturation Dynamic/Data Type Propagation
      BiasBase = Bias1  % mask workspace, SlipJudgement/Subsystem/加速度差的微分的判断/Filter1/Rate Limiter Dynamic/Saturation Dynamic/Data Type Propagation
      BiasBase = Bias1  % mask workspace, SlipJudgement/Subsystem/加速度差的微分的判断/Filter1/Saturation Dynamic/Data Type Propagation
      BiasBase = Bias1  % mask workspace, SlipJudgement/Subsystem/加速度差的微分的判断/Filter2/Rate Limiter Dynamic/Saturation Dynamic/Data Type Propagation
      BiasBase = Bias1  % mask workspace, SlipJudgement/Subsystem/加速度差的微分的判断/Filter2/Saturation Dynamic/Data Type Propagation
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    input "Scenario1" from WhlSlipJudgementTestSHEET.xls, mapped to IMU_Aa_mpss, VehSpdEstiZ1_mps, <VxFL_mps> -> VxFL_mps, <VxFR_mps> -> VxFR_mps, <VxRL_mps> -> VxRL_mps, <VxRR_mps> -> VxRR_mps (active)
    baseline "Scenario1"
      WhlSlipFLValid_flag
      WhlSlipFRValid_flag
      WhlSlipRLValid_flag
      WhlSlipRRValid_flag
      加速度差
      Divide:1
      加速度差的微分
      Divide4:1
      速差
      Add:1
      WhlSlipFLValid_flag
      WhlSlipFRValid_flag
      WhlSlipRLValid_flag
      WhlSlipRRValid_flag
      WhlSpdMax_mps