test file "TEST"

suite "New Test Suite 1"

  case "New Test Case 1" [baseline]
    test data file: TESTSHEET.xls
    model WaterPumpCtrl, harness WaterPumpCtrl_Harness2
    parameter set "TESTSHEET.xls":
      const = 40  % mask workspace, WaterPumpCtrl/Subsystem/Compare To Constant
      const = 45  % mask workspace, WaterPumpCtrl/Subsystem/Compare To Constant1
      const = 45  % mask workspace, WaterPumpCtrl/Subsystem/Compare To Constant2
      const = 50  % mask workspace, WaterPumpCtrl/Subsystem/Compare To Constant3
      const = 35  % mask workspace, WaterPumpCtrl/Subsystem/Compare To Constant4
    input "Scenario1" from TESTSHEET.xls, mapped to <MCFL_TempInverter> -> MCFL_TempInverter, <MCFR_TempInverter> -> MCFR_TempInverter, <MCU_temp> -> MCU_temp, <motor_temp> -> motor_temp (active)
    baseline "Scenario1"
      EmraxMotorTrq_CUT
      allAMKMotorTrq_CUT
      SingleAMKPowerLimit_KW:1
      allAMKMotorTrq_CUT:1
      aWaterPumpON:1
      SingleEmraxPowerLimit_KW:1
      EmraxMotorTrq_CUT:1
      LoadOfbWaterPump:1