% Simulink data dictionary VehCtrlMdelDictionary.sldd

thr1 = 2
thr2 = 0.5
thr3 = 0.8
thr4 = 0.5
thr5 = -0.5
Ldwf = 1.2
Ldwr = 1.16
TrqRquRate = 0.1
Q = 0.3
R = 0.1
Qa = 0.1
Ra = 2
m = 340
lf = 0.761
lr = 0.831
Car = 440
Caf = 460
Kp = 2
Ki = 1
dwf = 1.2
Rt = 0.2
u = 0.75
Ax_OffSet = 0
Ay_OffSet = 0
YawRate_OffSet = 0
Offset_Angle = 0
RearRatio = 0.8
Iz = 105
Kc = 1
h = 0.29
dwr = 1.2
i2 = 3.727
i1 = 11.42