% Simulink data dictionary VehCtrlMdelDictionary.sldd

thr1 = Simulink.Parameter(2, StorageClass="SimulinkGlobal")
thr2 = Simulink.Parameter(0.5, StorageClass="SimulinkGlobal")
thr3 = Simulink.Parameter(0.8, StorageClass="SimulinkGlobal")
thr4 = Simulink.Parameter(0.5, StorageClass="SimulinkGlobal")
thr5 = Simulink.Parameter(-0.5, StorageClass="SimulinkGlobal")
Ldwf = Simulink.Parameter(1.2, StorageClass="SimulinkGlobal")
Ldwr = Simulink.Parameter(1.16, StorageClass="SimulinkGlobal")
TrqRquRate = Simulink.Parameter(0.1, StorageClass="SimulinkGlobal")
Q = Simulink.Parameter(0.3, StorageClass="SimulinkGlobal")
R = Simulink.Parameter(0.1, StorageClass="SimulinkGlobal")
Qa = Simulink.Parameter(0.1, StorageClass="SimulinkGlobal")
Ra = Simulink.Parameter(2, StorageClass="SimulinkGlobal")
m = Simulink.Parameter(340, StorageClass="SimulinkGlobal")
lf = Simulink.Parameter(0.761, StorageClass="SimulinkGlobal")
lr = Simulink.Parameter(0.831, StorageClass="SimulinkGlobal")
Car = Simulink.Parameter(440, StorageClass="SimulinkGlobal")
Caf = Simulink.Parameter(460, StorageClass="SimulinkGlobal")
Kp = Simulink.Parameter(2, StorageClass="SimulinkGlobal")
Ki = Simulink.Parameter(1, StorageClass="SimulinkGlobal")
dwf = Simulink.Parameter(1.2, StorageClass="SimulinkGlobal")
Rt = Simulink.Parameter(0.2, StorageClass="SimulinkGlobal")
u = Simulink.Parameter(0.75, StorageClass="SimulinkGlobal")
Ax_OffSet = Simulink.Parameter(0, StorageClass="SimulinkGlobal")
Ay_OffSet = Simulink.Parameter(0, StorageClass="SimulinkGlobal")
YawRate_OffSet = Simulink.Parameter(0, StorageClass="SimulinkGlobal")
Offset_Angle = Simulink.Parameter(0, StorageClass="SimulinkGlobal")
RearRatio = Simulink.Parameter(0.8, StorageClass="SimulinkGlobal")
Iz = Simulink.Parameter(105, StorageClass="SimulinkGlobal")