test file "WhlSpdSelectTEST"

suite "New Test Suite 1"

  case "New Test Case 1" [baseline]
    test data file: WhlSpdSelectTestSHEET.xls
    model untitled, harness untitled_Harness4
    parameter set "WhlSpdSelectTestSHEET.xls":
      BiasAdd = 0  % mask workspace, untitled/Subsystem1/Filter/Rate Limiter Dynamic/Saturation Dynamic/Data Type Propagation
      BiasAdd = 0  % mask workspace, untitled/Subsystem1/Filter/Saturation Dynamic/Data Type Propagation
      BiasAdd = 0  % mask workspace, untitled/Subsystem1/Filter1/Rate Limiter Dynamic/Saturation Dynamic/Data Type Propagation
      BiasAdd = 0  % mask workspace, untitled/Subsystem1/Filter1/Saturation Dynamic/Data Type Propagation
      BiasAdd = 0  % mask workspace, untitled/Subsystem1/Rate Limiter Dynamic/Saturation Dynamic/Data Type Propagation
      BiasAdd = 0  % mask workspace, untitled/Subsystem1/Rate Limiter Dynamic1/Saturation Dynamic/Data Type Propagation
      BiasAdd = 0  % mask workspace, untitled/Subsystem1/Rate Limiter Dynamic2/Saturation Dynamic/Data Type Propagation
      BiasBase = Bias1  % mask workspace, untitled/Subsystem1/Filter/Rate Limiter Dynamic/Saturation Dynamic/Data Type Propagation
      BiasBase = Bias1  % mask workspace, untitled/Subsystem1/Filter/Saturation Dynamic/Data Type Propagation
      BiasBase = Bias1  % mask workspace, untitled/Subsystem1/Filter1/Rate Limiter Dynamic/Saturation Dynamic/Data Type Propagation
      BiasBase = Bias1  % mask workspace, untitled/Subsystem1/Filter1/Saturation Dynamic/Data Type Propagation
      BiasBase = Bias1  % mask workspace, untitled/Subsystem1/Rate Limiter Dynamic/Saturation Dynamic/Data Type Propagation
      BiasBase = Bias1  % mask workspace, untitled/Subsystem1/Rate Limiter Dynamic1/Saturation Dynamic/Data Type Propagation
      BiasBase = Bias1  % mask workspace, untitled/Subsystem1/Rate Limiter Dynamic2/Saturation Dynamic/Data Type Propagation
      BiasMult = 1  % mask workspace, untitled/Subsystem1/Filter/Rate Limiter Dynamic/Saturation Dynamic/Data Type Propagation
      BiasMult = 1  % mask workspace, untitled/Subsystem1/Filter/Saturation Dynamic/Data Type Propagation
      BiasMult = 1  % mask workspace, untitled/Subsystem1/Filter1/Rate Limiter Dynamic/Saturation Dynamic/Data Type Propagation
      BiasMult = 1  % mask workspace, untitled/Subsystem1/Filter1/Saturation Dynamic/Data Type Propagation
      BiasMult = 1  % mask workspace, untitled/Subsystem1/Rate Limiter Dynamic/Saturation Dynamic/Data Type Propagation
      BiasMult = 1  % mask workspace, untitled/Subsystem1/Rate Limiter Dynamic1/Saturation Dynamic/Data Type Propagation
      BiasMult = 1  % mask workspace, untitled/Subsystem1/Rate Limiter Dynamic2/Saturation Dynamic/Data Type Propagation
      IfRefDouble = double  % mask workspace, untitled/Subsystem1/Filter/Rate Limiter Dynamic/Saturation Dynamic/Data Type Propagation
      IfRefDouble = double  % mask workspace, untitled/Subsystem1/Filter/Saturation Dynamic/Data Type Propagation
      IfRefDouble = double  % mask workspace, untitled/Subsystem1/Filter1/Rate Limiter Dynamic/Saturation Dynamic/Data Type Propagation
      IfRefDouble = double  % mask workspace, untitled/Subsystem1/Filter1/Saturation Dynamic/Data Type Propagation
      IfRefDouble = double  % mask workspace, untitled/Subsystem1/Rate Limiter Dynamic/Saturation Dynamic/Data Type Propagation
      IfRefDouble = double  % mask workspace, untitled/Subsystem1/Rate Limiter Dynamic1/Saturation Dynamic/Data Type Propagation
      IfRefDouble = double  % mask workspace, untitled/Subsystem1/Rate Limiter Dynamic2/Saturation Dynamic/Data Type Propagation
      IfRefSingle = single  % mask workspace, untitled/Subsystem1/Filter/Rate Limiter Dynamic/Saturation Dynamic/Data Type Propagation
      IfRefSingle = single  % mask workspace, untitled/Subsystem1/Filter/Saturation Dynamic/Data Type Propagation
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    input "Scenario1" from WhlSpdSelectTestSHEET.xls, mapped to WhlSlipFL_flag, WhlSlipFR_flag, WhlSlipRL_flag, WhlSlipRR_flag, IMU_Ax_mpss, VxIMU_est, IMUVehSpdEstiExit, <VxFL_mps> -> VxFL_mps, <VxFR_mps> -> VxFR_mps, <VxRL_mps> -> VxRL_mps, <VxRR_mps> -> VxRR_mps (active)
    baseline "Scenario1"
      VehVxEst1_mps:1
      AccEst_mpss:1